# Grasshopper definition structuralskeleton.gh (Grasshopper 1.0.8)

# ----
# # COLUMNS
# LONG
# DIRECTION
number_slider = Slider(5, range=1..12)

of_stories = Slider(5, range=1..10)
stories = GetInteger(of_stories, AtLeast=1, AtMost=1, Maximum=2147483647, Minimum=-2147483648, TreeAccess=False)
y_axis = GetInteger(Slider(9, range=3..9), AtLeast=1, AtMost=1, Maximum=2147483647, Minimum=-2147483648, TreeAccess=False)
x_axis = GetInteger(Slider(5, range=3..7), AtLeast=1, AtMost=1, Maximum=2147483647, Minimum=-2147483648, TreeAccess=False)
# DATA HALL
columns = GetInteger(number_slider, AtLeast=1, AtMost=1, Maximum=2147483647, Minimum=-2147483648, TreeAccess=False)
multiplication = Multiplication(A=stories, B="4.5")
multiplication_2 = Multiplication(A=y_axis, B="4.5")
multiplication_3 = Multiplication(A=x_axis, B="4.5")
range = Range(Domain=multiplication, Steps=stories)
number = Number(multiplication_2)
number_2 = Number(multiplication_3)
unit_z = UnitZ(Factor=multiplication)
rectangle = Rectangle(Plane=PlaneXY(0, 0, 0), XSize=number_2, YSize=number, Radius=0)  # -> Rectangle, Length
surface = Surface(rectangle.Rectangle)
deconstruct_brep = DeconstructBrep(Brep=surface)  # -> Faces, Edges, Vertices
offset_surface = OffsetSurface(Surface=surface, Distance=range, Retrim=True)
panel = Panel(offset_surface)
curve = Curve(deconstruct_brep.Edges)
panel_2 = Panel("""0
-1""")
extrude = Extrude(Base=curve, Direction=unit_z)
surface_2 = Surface(flatten(offset_surface))
cull_index = CullIndex(List=offset_surface, Indices=panel_2, Wrap=True)
list_item = ListItem(List=offset_surface, Index="-1", Wrap=True)
deconstruct_brep_2 = DeconstructBrep(Brep=extrude)  # -> flatten(Faces), Edges, Vertices

# ----
# FLOOR
# PLATES
surface_3 = Surface(cull_index)

# ----
# ROOF
surface_4 = Surface(list_item)

list_item_2 = ListItem(List=deconstruct_brep_2.Faces, Index="3", Wrap=True)
list_item_3 = ListItem(List=deconstruct_brep_2.Faces, Index="0", Wrap=True)
list_item_4 = ListItem(List=deconstruct_brep_2.Faces, Index="1", Wrap=True)
list_item_5 = ListItem(List=deconstruct_brep_2.Faces, Index="2", Wrap=True)
deconstruct_brep_3 = DeconstructBrep(Brep=surface_2)  # -> Faces, Edges, Vertices

# ----
# IMPORT
# DATA CENTER
# PERIMETER GEOMETRY
curve_2 = Curve(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)

panel_3 = Panel(deconstruct_brep_3.Faces)
surface_5 = Surface([list_item_3, list_item_4, list_item_5, list_item_2])
panel_4 = Panel(surface_5)
list_item_6 = ListItem(List=deconstruct_brep_3.Edges, Index="1", Wrap=True)
list_item_7 = ListItem(List=deconstruct_brep_3.Edges, Index="3", Wrap=True)

# ----
# FACADE
facade = Surface(surface_5)

divide_curve = DivideCurve(Curve=list_item_7, Count=columns, Kinks=False)  # -> Points, Tangents, Parameters
divide_curve_2 = DivideCurve(Curve=list_item_6, Count=columns, Kinks=False)  # -> Points, Tangents, Parameters
expression = Expression(x=columns, Expression="x+1")
range_2 = Range(Domain=Domain(0, 1), Steps=10)
series = Series(Start=divide_curve_2.Points, Step=1, Count=10)
point_list = PointList(Points=divide_curve_2.Points, Size=Slider(1.5, range=0..10))
reverse_list = ReverseList(List=divide_curve_2.Points)
list_item_8 = ListItem(List=deconstruct_brep_3.Edges, Index="0", Wrap=True)
list_item_9 = ListItem(List=deconstruct_brep_3.Edges, Index="2", Wrap=True)
partition_list = PartitionList(List=divide_curve.Points, Size=expression)
partition_list_2 = PartitionList(List=reverse_list, Size=expression)
line = Line(StartPoint=partition_list_2, EndPoint=partition_list)
divide_curve_3 = DivideCurve(Curve=list_item_8, Count="3", Kinks=False)  # -> Points, Tangents, Parameters
divide_curve_4 = DivideCurve(Curve=list_item_9, Count="3", Kinks=False)  # -> Points, Tangents, Parameters
panel_5 = Panel("""0
-1""")
panel_6 = Panel("""0
-1""")
flip_matrix = FlipMatrix(Data=partition_list)
flip_matrix_2 = FlipMatrix(Data=flip_matrix)
polyline = PolyLine(Vertices=flip_matrix_2, Closed=False)
explode = Explode(Curve=polyline, Recursive=True)  # -> Segments, Vertices
list_length = ListLength(List=explode.Segments)
flip_matrix_3 = FlipMatrix(Data=partition_list_2)
flip_matrix_4 = FlipMatrix(Data=flip_matrix_3)
polyline_2 = PolyLine(Vertices=flip_matrix_4, Closed=False)
explode_2 = Explode(Curve=polyline_2, Recursive=True)  # -> Segments, Vertices
list_length_2 = ListLength(List=explode_2.Segments)
division = Division(A=list_length_2, B="2")
panel_7 = Panel("""0
-1""")
panel_8 = Panel("""0
-1""")
cull_index_2 = CullIndex(List=line, Indices=panel_5, Wrap=True)
division_2 = Division(A=list_length, B="2")
list_item_10 = ListItem(List=line, Index=panel_6, Wrap=True)
cull_index_3 = CullIndex(List=divide_curve_3.Points, Indices=panel_7, Wrap=True)
round = Round(Number=division)  # -> Nearest, Floor, Ceiling
cull_index_4 = CullIndex(List=divide_curve_4.Points, Indices=panel_8, Wrap=True)
round_2 = Round(Number=division_2)  # -> Nearest, Floor, Ceiling
flip_matrix_5 = FlipMatrix(Data=list_item_10)
cull_index_5 = CullIndex(List=flip_matrix, Indices="0", Wrap=True)
cull_index_6 = CullIndex(List=flip_matrix_3, Indices="0", Wrap=True)
point_list_2 = PointList(Points=flip_matrix_3)
flip_matrix_6 = FlipMatrix(Data=reverse_list)
flip_matrix_7 = FlipMatrix(Data=divide_curve.Points)
flip_matrix_8 = FlipMatrix(Data=cull_index_2)
flip_matrix_9 = FlipMatrix(Data=cull_index_3)
flip_matrix_10 = FlipMatrix(Data=cull_index_4)
list_item_11 = ListItem(List=explode_2.Segments, Index=round.Nearest, Wrap=True)
flip_matrix_11 = FlipMatrix(Data=cull_index_5)
flip_matrix_12 = FlipMatrix(Data=cull_index_6)
cull_index_7 = CullIndex(List=flip_matrix_5, Indices="0", Wrap=True)
list_item_12 = ListItem(List=explode.Segments, Index=round_2.Nearest, Wrap=True)
polyline_3 = PolyLine(Vertices=flip_matrix_6, Closed=False)
polyline_4 = PolyLine(Vertices=flip_matrix_7, Closed=False)
cull_index_8 = CullIndex(List=flip_matrix_8, Indices="0", Wrap=True)
polyline_5 = PolyLine(Vertices=flip_matrix_9, Closed=False)
polyline_6 = PolyLine(Vertices=flip_matrix_10, Closed=False)
divide_curve_5 = DivideCurve(Curve=list_item_11, Count="1", Kinks=False)  # -> Points, Tangents, Parameters
flip_matrix_13 = FlipMatrix(Data=cull_index_7)
end_points = EndPoints(Curve=list_item_11)  # -> Start, End
polyline_7 = PolyLine(Vertices=flip_matrix_12, Closed=False)
polyline_8 = PolyLine(Vertices=flip_matrix_11, Closed=False)
flip_matrix_14 = FlipMatrix(Data=flip_matrix_5)
divide_curve_6 = DivideCurve(Curve=list_item_12, Count="1", Kinks=False)  # -> Points, Tangents, Parameters
end_points_2 = EndPoints(Curve=list_item_12)  # -> Start, End
divide_curve_7 = DivideCurve(Curve=flip_matrix_13, Count="3", Kinks=False)  # -> Points, Tangents, Parameters
explode_3 = Explode(Curve=polyline_3, Recursive=True)  # -> Segments, Vertices
explode_4 = Explode(Curve=polyline_4, Recursive=True)  # -> Segments, Vertices
explode_5 = Explode(Curve=polyline_6, Recursive=True)  # -> Segments, Vertices
explode_6 = Explode(Curve=polyline_5, Recursive=True)  # -> Segments, Vertices
point = Point(flatten(end_points.End))
point_2 = Point(flatten(end_points.Start))
divide_curve_8 = DivideCurve(Curve=flip_matrix_14, Count="3", Kinks=False)  # -> Points, Tangents, Parameters
point_3 = Point(flatten(end_points_2.End))
point_4 = Point(flatten(end_points_2.Start))
polyline_9 = PolyLine(Vertices=divide_curve_7.Points, Closed=False)
explode_7 = Explode(Curve=polyline_8, Recursive=True)  # -> Segments, Vertices
explode_8 = Explode(Curve=polyline_7, Recursive=True)  # -> Segments, Vertices
shift_list = ShiftList(List=point_2, Shift=1, Wrap=True)
point_list_3 = PointList(Points=divide_curve_7.Points)
explode_9 = Explode(Curve=cull_index_8, Recursive=True)  # -> Segments, Vertices
shift_list_2 = ShiftList(List=point_4, Shift=1, Wrap=True)
panel_9 = Panel("""0
-1""")

# ----
# long
# PERIMETER
# COLUMNS
perimeter_columns_long = Line([explode_3.Segments, explode_4.Segments])

cull_index_9 = CullIndex(List=shift_list, Indices="-1", Wrap=True)
cull_index_10 = CullIndex(List=point, Indices="-1", Wrap=True)

# ----
# short
# PERIMETER
# COLUMNS
perimeter_columns_short = Curve([explode_6.Segments, explode_5.Segments])

explode_10 = Explode(Curve=polyline_9, Recursive=True)  # -> Segments, Vertices
cull_index_11 = CullIndex(List=shift_list_2, Indices="-1", Wrap=True)
cull_index_12 = CullIndex(List=point_3, Indices="-1", Wrap=True)
cull_index_13 = CullIndex(List=divide_curve_8.Points, Indices=panel_9, Wrap=True)  # -> simplify(List)

# ----
# BEAMS
# LONG
beams_long = Line([explode_8.Segments, explode_7.Segments])

# ----
# BEAMS
# SHORT
beams_short = Line([explode_9.Segments, explode_10.Segments])

line_2 = Line(StartPoint=cull_index_9, EndPoint=cull_index_10)
line_3 = Line(StartPoint=cull_index_11, EndPoint=cull_index_12)
relative_item = RelativeItem(Tree=cull_index_13, Offset="{1;0}[+1]", WrapPaths=False, WrapItems=False)  # -> ItemA, ItemB

# ----
# BRACING
# short column
# direction
line_4 = Line(StartPoint=relative_item.ItemA, EndPoint=relative_item.ItemB)  # -> flatten(Line)

list_length_3 = ListLength(List=[perimeter_columns_short, perimeter_columns_long])  # -> flatten(Length)

# ----
# BRACING
# long column
# direction
curve_3 = Curve([line_2, line_3])

explode_tree = ExplodeTree(Data=list_length_3)  # -> Branch0, Branch1
entwine = Entwine(
    Branch00=beams_long,
    Branch01=beams_short,
    Branch02=perimeter_columns_long,
    Branch03=perimeter_columns_short,
    FlattenInputs=True)
list_length_4 = ListLength(List=beams_short)  # -> flatten(Length)
list_length_5 = ListLength(List=beams_long)  # -> flatten(Length)
list_length_6 = ListLength(List=entwine)
mass_addition = MassAddition(Input=list_length_4)  # -> Result, PartialResults
mass_addition_2 = MassAddition(Input=list_length_5)  # -> Result, PartialResults
mass_addition_3 = MassAddition(Input=list_length_3)  # -> Result, PartialResults
panel_10 = Panel(list_length_6)
pipe = Pipe(Curve=[curve_3, line_4], Radius=".2", Caps=0)
panel_11 = Panel(mass_addition.Result)
panel_12 = Panel(mass_addition_2.Result)
panel_13 = Panel(mass_addition_3.Result)
mass_addition_4 = MassAddition(Input=flatten(panel_10))  # -> Result, PartialResults
list_item_13 = ListItem(List=explode_8.Vertices, Index="0", Wrap=True)
point_5 = Point(explode_8.Vertices)
point_6 = Point(explode_4.Vertices)
point_7 = Point(list_item_13)
point_8 = Point(explode_6.Vertices)
point_9 = Point(explode_3.Vertices)
point_10 = Point(explode_5.Vertices)
negative = Negative(Value=Slider(1, range=0..1))
negative_2 = Negative(Value=Slider(1, range=0..1))
list_item_14 = ListItem(List=explode_7.Vertices, Index="0", Wrap=True)
negative_3 = Negative(Value=Slider(1, range=0..1))
negative_4 = Negative(Value=Slider(1, range=0..1))
negative_5 = Negative(Value=Slider(1, range=0..1))
negative_6 = Negative(Value=Slider(1, range=0..1))
negative_7 = Negative(Value=Slider(1, range=0..1))
division_3 = Division(A=Slider(1, range=0..1), B="2")
division_4 = Division(A=Slider(1, range=0..1), B="2")
division_5 = Division(A=negative, B="2")
division_6 = Division(A=negative_2, B="2")
yz_plane = YZPlane(Origin=point_5)
division_7 = Division(A=Slider(1, range=0..1), B="2")
point_11 = Point(list_item_14)
division_8 = Division(A=negative_3, B="2")
division_9 = Division(A=Slider(1, range=0..1), B="2")
division_10 = Division(A=Slider(1, range=0..1), B="2")
division_11 = Division(A=negative_4, B="2")
division_12 = Division(A=negative_5, B="2")
xz_plane = XZPlane(Origin=point_7)
division_13 = Division(A=Slider(1, range=0..1), B="2")
division_14 = Division(A=negative_6, B="2")
division_15 = Division(A=Slider(1, range=0..1), B="2")
division_16 = Division(A=negative_7, B="2")
xz_plane_2 = XZPlane(Origin=point_11)
construct_domain = ConstructDomain(DomainStart=division_3, DomainEnd=division_5)
construct_domain_2 = ConstructDomain(DomainStart=division_4, DomainEnd=division_6)
construct_domain_3 = ConstructDomain(DomainStart=division_7, DomainEnd=division_8)
construct_domain_4 = ConstructDomain(DomainStart=division_9, DomainEnd=division_11)
construct_domain_5 = ConstructDomain(DomainStart=division_10, DomainEnd=division_12)
construct_domain_6 = ConstructDomain(DomainStart=division_13, DomainEnd=division_14)
construct_domain_7 = ConstructDomain(DomainStart=division_15, DomainEnd=division_16)
rectangle_2 = Rectangle(Plane=yz_plane, XSize=construct_domain, YSize=construct_domain, Radius=0)  # -> Rectangle, Length
rectangle_3 = Rectangle(Plane=point_6, XSize=construct_domain_2, YSize=construct_domain_2, Radius=0)  # -> Rectangle, Length
rectangle_4 = Rectangle(Plane=xz_plane, XSize=construct_domain_3, YSize=construct_domain_3, Radius=0)  # -> Rectangle, Length
rectangle_5 = Rectangle(Plane=point_8, XSize=construct_domain_4, YSize=construct_domain_4, Radius=0)  # -> Rectangle, Length
rectangle_6 = Rectangle(Plane=point_9, XSize=construct_domain_5, YSize=construct_domain_5, Radius=0)  # -> Rectangle, Length
rectangle_7 = Rectangle(Plane=point_10, XSize=construct_domain_6, YSize=construct_domain_6, Radius=0)  # -> Rectangle, Length
rectangle_8 = Rectangle(Plane=xz_plane_2, XSize=construct_domain_7, YSize=construct_domain_7, Radius=0)  # -> Rectangle, Length
loft = Loft(
    Curves=rectangle_3.Rectangle,
    Options={Adjust=False, Closed=False, LoftEnds=0, LoftSimp=0, LoftType=0, Rebuild=10, Refit=0.01})
loft_2 = Loft(
    Curves=rectangle_5.Rectangle,
    Options={Adjust=False, Closed=False, LoftEnds=0, LoftSimp=0, LoftType=0, Rebuild=10, Refit=0.01})
loft_3 = Loft(
    Curves=rectangle_6.Rectangle,
    Options={Adjust=False, Closed=False, LoftEnds=0, LoftSimp=0, LoftType=0, Rebuild=10, Refit=0.01})
extrude_along = ExtrudeAlong(Base=rectangle_2.Rectangle, Curve=cull_index_8)
loft_4 = Loft(
    Curves=rectangle_7.Rectangle,
    Options={Adjust=False, Closed=False, LoftEnds=0, LoftSimp=0, LoftType=0, Rebuild=10, Refit=0.01})
extrude_along_2 = ExtrudeAlong(Base=rectangle_4.Rectangle, Curve=polyline_7)
extrude_along_3 = ExtrudeAlong(Base=rectangle_8.Rectangle, Curve=polyline_7)
brep = Brep([loft, loft_3, loft_2, loft_4])
brep_2 = Brep([extrude_along, extrude_along_2, extrude_along_3, pipe])
brep_3 = Brep(flatten([brep, brep_2]))
area = Area(Geometry=brep_3)  # -> Area, Centroid
context_bake = ContextBake(Content=brep_3)
context_print = ContextPrint(Text=area.Area)
